% Simulink data dictionary NavigationDictionary.sldd

gpsBus = Simulink.Bus()
  pos: double[3 1]
  timestamp: double
  validity: boolean

accelBus = Simulink.Bus()
  accel: double[3 1]
  timestamp: double
  validity: boolean

angvelBus = Simulink.Bus()
  angvel: double[3 1]
  timestamp: double
  validity: boolean

baroBus = Simulink.Bus()
  height: double
  timestamp: double
  validity: boolean

lidarBus = Simulink.Bus()
  distance: double
  timestamp: double
  validity: boolean