% Simulink data dictionary NavigationDictionary.sldd

accelBus = Simulink.Bus()
  accel: double[3 1]  % Acceleration in body frame (m/s^2)
  timestamp: double  % Time since start (s)
  validity: boolean  % Valid measurement (true), (false) otherwise

angvelBus = Simulink.Bus()
  angvel: double[3 1]  % Angular velocity in body frame (deg/s)
  timestamp: double  % Time since start (s)
  validity: boolean  % Valid measurement (true), (false) otherwise

baroBus = Simulink.Bus()
  height: double  % Height measured from the ground (m)
  timestamp: double  % Time since start (s)
  validity: boolean  % Valid measurement (true), (false) otherwise

lidarBus = Simulink.Bus()
  distance: double  % Distance to surface measured by LIDAR sensor (m)
  timestamp: double  % Time since start (s)
  validity: boolean  % Valid measurement (true), (false) otherwise

gpsBus = Simulink.Bus()
  pos: double[3 1]  % Position in NED frame (m)
  vel: double[3 1]  % Velocity in NED frame (m)
  timestamp: double  % Time since start (s)
  validity: boolean  % Valid measurement (true), (false) otherwise

magBus = Simulink.Bus()
  bfield_meas: double[3 1]  % Magnetic field measurement in body frame (nT)
  bfield_E: double  % Magnetic field in NED frame from magnetic field model (nT)
  timestamp: double  % Time since start (s)
  validity: boolean  % Valid measurement (true), (false) otherwise

gravity = Simulink.ValueType(DataType="double", be=Simulink.BusElement(Name="a", DataType="double"))  % Local acceleration due to gravity, positive scalar (m/s^2)
timestep = Simulink.ValueType(DataType="double", be=Simulink.BusElement(Name="a", DataType="double"))  % Time step for each filter cycle (s)

InitConditions = Simulink.Bus()
  x0: double  % Initial state
  P0: double  % Initial covariance

reset = Simulink.ValueType(DataType="double", be=Simulink.BusElement(Name="a", DataType="double"))  % Feed zero for this signal, pull up to greater than zero to reset the filter to given intial conditions

biasBus = Simulink.Bus()  % Bias struct for sensor models exposed for Monte Carlo purposes
  accelBias: double[3 1]  % Acceleration measurement bias in body frame (m's^2)
  gyroBias: double[3 1]  % Gyro measurement bias in NED frame (rad/s)
  baroBias: double  % Barometer measurement bias (m)