% Simulink data dictionary NavigationDictionary.sldd

gravity = Simulink.ValueType(DataType="double", be=Simulink.BusElement(Name="a", DataType="double"))  % Local acceleration due to gravity, positive scalar (m/s^2)
timestep = Simulink.ValueType(DataType="double", be=Simulink.BusElement(Name="a", DataType="double"))  % Time step for each filter cycle (s)
reset = Simulink.ValueType(DataType="double", be=Simulink.BusElement(Name="a", DataType="double"))  % Feed zero for this signal, pull up to greater than zero to reset the filter to given intial conditions

biasBus = Simulink.Bus()  % Bias struct for sensor models exposed for Monte Carlo purposes
  accelBias: double[3 1]  % Acceleration measurement bias in body frame (m's^2)
  gyroBias: double[3 1]  % Gyro measurement bias in NED frame (rad/s)
  baroBias: double  % Barometer measurement bias (m)

torque = Simulink.ValueType(DataType="double", Dimensions=[3 1], be=Simulink.BusElement(Name="a", DataType="double"))  % Torque controller is applying in body frame (Nm)

massProperties = Simulink.Bus()
  m: double  % mass (kg)
  J: double[3 3]  % Inertia tensor (xyz aligning with body frame) (kg*m^2)

accelBus = Simulink.Bus()
  accel: double[3 1]  % Acceleration in body frame (m/s^2)
  covariance: double[3 3]  % Measurement covariance (R)
  timestamp: double  % Time since start (s)
  validity: boolean  % Valid measurement (true), (false) otherwise

angvelBus = Simulink.Bus()
  angvel: double[3 1]  % Angular velocity in body frame (deg/s)
  covariance: double[3 3]  % Measurement covariance
  timestamp: double  % Time since start (s)
  validity: boolean  % Valid measurement (true), (false) otherwise

baroBus = Simulink.Bus()
  height: double  % Height measured from the ground (m)
  covariance: double  % Measurement covariance
  timestamp: double  % Time since start (s)
  validity: boolean  % Valid measurement (true), (false) otherwise

gpsBus = Simulink.Bus()
  pos: double[3 1]  % Position in NED frame (m)
  pcovariance: double[3 3]  % Position measurement covariance
  vel: double[3 1]  % Velocity in NED frame (m)
  vcovariance: double[3 3]  % Velocity measurement covariance
  timestamp: double  % Time since start (s)
  validity: boolean  % Valid measurement (true), (false) otherwise

Qc = Simulink.ValueType(DataType="double", Dimensions=[13 13], be=Simulink.BusElement(Name="a", DataType="double"))  % Process noise covariance matrix

gpsFrameBus = Simulink.Bus()
  r1: double[3 1]  % Postion of antenna 1 relative to vehicle COM in body frame (m)
  r2: double[3 1]  % Position of antenna 2 relative to vehicle COM in body frame (m)

lidarFrameBus = Simulink.Bus()  % Contains LIDAR frame information (filter input)
  A1: double[3 3]  % Rotation matrix to actively rotate unit vector from x-axis to LIDAR direction (body frame)
  A2: double[3 3]  % Rotation matrix to actively rotate unit vector from x-axis to LIDAR direction (body frame)
  A3: double[3 3]  % Rotation matrix to actively rotate unit vector from x-axis to LIDAR direction (body frame)
  A4: double[3 3]  % Rotation matrix to actively rotate unit vector from x-axis to LIDAR direction (body frame)
  r1: double[3 1]  % Body frame vector from vehicle center of mass to LIDAR tip (m)
  r2: double[3 1]  % Body frame vector from vehicle center of mass to LIDAR tip (m)
  r3: double[3 1]  % Body frame vector from vehicle center of mass to LIDAR tip (m)
  r4: double[3 1]  % Body frame vector from vehicle center of mass to LIDAR tip (m)
  heightCOM: double  % Height of the vehicle COM from ground on vehicle initialization

diffGpsBus = Simulink.Bus()
  basisVec: double[3 1]  % Vector from one antenna to the other in inertial (NED) frame
  covariance: double[3 3]  % Measurement covariance
  timestamp: double  % Time since start (s)
  validity: boolean  % Valid measurement (true), (false) otherwise

lidarBus = Simulink.Bus()  % Output by the LIDAR system model
  distance: double[4 1]  % Distance to surface measured by each LIDAR sensor (m)
  covariance: double[4 1]  % Measurement covariance (list corresponding to each sensor)
  timestamp: double  % Time since start (s)
  validity: boolean[4 1]  % Valid measurement for each LIDAR sensor (true), (false) otherwise

InitConditions = Simulink.Bus()
  x0: double[20 1]  % Initial state
  P0: double[19 19]  % Initial covariance

magBus = Simulink.Bus()
  bfield_meas: double[3 1]  % Magnetic field measurement in body frame (nT)
  covariance: double[3 3]  % Measurement covariance
  bfield_E: double[3 1]  % Magnetic field in NED frame from magnetic field model (nT)
  timestamp: double  % Time since start (s)
  validity: boolean  % Valid measurement (true), (false) otherwise